# Grasshopper definition llm_requests_windows.gh (Grasshopper 1.0.8)
# plug-ins: ShapeDiverForGrasshopper

sddp = ShapeDiverDocumentPayload({AbsoluteTolerance=0, AngleTolerance=0, DistanceDisplayPrecision=0, GltfVersion="Gltf2", GrasshopperVersion="1.0.0008", InputGroups="{}", OutputGroups="{}", RelativeTolerance=0, RhinoVersion="8.19.25132.1001", UnitSystem=0, VersionCreated="1.26.0.0", VersionSaved="1.26.0.0"})
py3 = Python3Script(input_text="how do i bake cookies?", run=Toggle(False))  # -> out, out_2
# ---------- py3: Python ----------
#r: requests

import requests

url = 'http://localhost:5000/llm_call'
payload = {'input': input_text}


out = None
if run:
    response = requests.post(url, json=payload)

    if response.status_code == 200:
        data = response.json()
        out = data['response']
    else:
        out = "Failed to connect:"

a = out
# ---------- end py3 ----------
panel = Panel(py3.out_2)
py3_2 = Python3Script(input_text="san diego, california", run=Toggle(False))  # -> out, min_range, max_range, description
# ---------- py3_2: Python ----------
#r: requests

import requests

url = 'http://localhost:5000/llm_call'
payload = {'input': input_text}


out = None
if run:
    response = requests.post(url, json=payload)

    if response.status_code == 200:
        data = response.json()
        out = data['response']
    else:
        out = "Failed to connect:"


print(out)
# ---------- end py3_2 ----------
panel_2 = Panel(py3_2.description)
python_3_script = Python3Script(input_text="san diego, california", run=Toggle(True))  # -> out, points
# ---------- python_3_script: Python ----------
#r: requests

import requests
from ghpythonlib.treehelpers import list_to_tree

url = 'http://localhost:5000/llm_call'
payload = {'input': input_text}


out = None
if run:
    response = requests.post(url, json=payload)

    if response.status_code == 200:
        data = response.json()
        out = data['response']
    else:
        out = "Failed to connect:"

try:
    print(out)
    text = out.splitlines()
    point1 = []
    for t in text:
        t = t.replace("[","")
        t = t.replace("]","")
        print(t)
        x, y = t.split(",")
        point1.append([x,y])

    points = list_to_tree(point1)
except Exception as e:
    # simple print
    print("Caught exception:", e)
    print("Incorrect format")
# ---------- end python_3_script ----------
panel_3 = Panel(py3_2.out)
panel_4 = Panel(py3_2.max_range)
panel_5 = Panel(py3_2.min_range)
number = Number(python_3_script.points)
panel_6 = Panel(number)
list_item = ListItem(List=panel_6, Index=0, Wrap=True)  # -> Item, Item1
construct_point = ConstructPoint(XCoordinate=list_item.Item, YCoordinate=list_item.Item1, ZCoordinate=0)  # -> flatten(Point)
number_slider = Slider(3, range=0..10)
list_item_2 = ListItem(List=construct_point, Index=0, Wrap=True)  # -> Item, Item1
rectangle = Rectangle(Plane=PlaneXY(0, 0, 0), XSize=number_slider, YSize=number_slider, Radius=0)  # -> Rectangle, Length
rectangle_2pt = Rectangle2Pt(Plane=PlaneXY(0, 0, 0), PointA=list_item_2.Item, PointB=list_item_2.Item1, Radius=0)  # -> Rectangle, Length
curve = Curve(rectangle_2pt.Rectangle)
curve_2 = Curve(rectangle.Rectangle)
boundary_surfaces = BoundarySurfaces(Edges=curve)
data_recorder = DataRecorder(boundary_surfaces, DataLimit=-10, RecordData=True)
boundary_surfaces_2 = BoundarySurfaces(Edges=curve_2)
surface = Surface(data_recorder)
list_item_3 = ListItem(List=surface, Index=Slider(0, range=0..10), Wrap=True)
region_difference = RegionDifference(CurvesA=boundary_surfaces_2, CurvesB=list_item_3)
discontinuity = Discontinuity(Curve=region_difference, Level=1)  # -> Points, Parameters
boundary_surfaces_3 = BoundarySurfaces(Edges=region_difference)
custom_preview = CustomPreview(Geometry=list_item_3, Material=ColourSwatch(SwatchColor=RGB(156, 219, 255)))
flip_matrix = FlipMatrix(Data=discontinuity.Points)
custom_preview_2 = CustomPreview(Geometry=boundary_surfaces_3, Material=ColourSwatch(SwatchColor=RGB(255, 255, 255)))
panel_7 = Panel(data_recorder)
polyline = PolyLine(Vertices=flip_matrix, Closed=False)
